# Grasshopper definition Twist.ghx (Grasshopper 1.0.8)

# ---- group: Inputs
degrees = Slider(5, range=0..10)
axisbase = Point(Point(0, 0, 0))

# ----
geomin = Geometry(<extrusion referenced from the Rhino model>)
Z = UnitZ(Factor=1)
move = Move(Geometry=axisbase, Motion=Z)  # -> Geometry, Transform
rad = Radians(Degrees=degrees)
ln = Line(StartPoint=axisbase, EndPoint=move.Geometry)
twist = Twist(Geometry=geomin, Axis=ln, Angle=rad, Infinite=True, Rigid=False)

# ---- group: Outputs
rotation = Number(expr("x*10", degrees))
rotation_2 = Number(degrees)
geomout = Geometry(twist)
